% Simulink data dictionary fcs_spec.sldd

f_IMU = Simulink.Parameter(1000, Unit="Hz")
f_Mag = Simulink.Parameter(50, Unit="Hz")
f_Baro_Alt = Simulink.Parameter(50, Unit="Hz")
f_GPS = Simulink.Parameter(10, Unit="Hz")
f_Pitot = Simulink.Parameter(50, Unit="Hz")
density_of_air = Simulink.Parameter(1.2, Unit="kg/m^3")
g = Simulink.Parameter(9.8, Unit="m/s^2")