% Simulink data dictionary sensor_datasheet.sldd

f_IMU = Simulink.Parameter(1000, Unit="Hz")
f_Mag = Simulink.Parameter(50, Unit="Hz")
f_Baro_Alt = Simulink.Parameter(50, Unit="Hz")
f_GPS = Simulink.Parameter(10, Unit="Hz")
f_Pitot = Simulink.Parameter(50, Unit="Hz")
raw_data_IMU_size = Simulink.Parameter(6)
raw_data_Mag_size = Simulink.Parameter(3)
raw_data_Baro_Alt_size = Simulink.Parameter(1)
raw_data_GPS_size = Simulink.Parameter(3)
raw_data_Pitot_size = Simulink.Parameter(1)
tol_Baro_Alt = Simulink.Parameter(1, Unit="m")
tol_Pitot = Simulink.Parameter(2, Unit="m/s")
tol_Mag = Simulink.Parameter([10; 10; 10], Unit="uT")
tol_GPS = Simulink.Parameter([5; 5; 5], Unit="m")
tol_IMU = Simulink.Parameter([1; 1; 1; 0.018; 0.018; 0.018])