% Simulink data dictionary fcs_spec.sldd

f_outer_loop = Simulink.Parameter(50, Unit="Hz")
f_inner_loop = Simulink.Parameter(400, Unit="Hz")
f_sensor_acquisition = Simulink.Parameter(400, Unit="Hz")
f_fidr = Simulink.Parameter(400, Unit="Hz")
f_IMU = Simulink.Parameter(800, Unit="hertz")
f_mission_manager = Simulink.Parameter(50, Unit="Hz")
Takeoff_Spd = Simulink.Parameter(50, Unit="m/s")
Takeoff_Alt = Simulink.Parameter(2, Unit="m")
Climb_Alt = Simulink.Parameter(50, Unit="m")
Cruise_Alt = Simulink.Parameter(3000, Unit="m")
Landing_Alt = Simulink.Parameter(20, Unit="m")
Roll_Rate_Max = Simulink.Parameter(1.57, Unit="rad/s")
Pitch_Rate_Max = Simulink.Parameter(1.05, Unit="rad/s")
Yaw_Rate_Max = Simulink.Parameter(0.52, Unit="rad/s")
Roll_Angle_Max = Simulink.Parameter(1.15, Unit="rad")  % 66deg
Pitch_Angle_Max = Simulink.Parameter(0.4363, Unit="rad")  % 25deg
Pitch_Angle_Min = Simulink.Parameter(-0.261799, Unit="rad")  % -15deg
f_Mag = Simulink.Parameter(50, Unit="Hz")
f_Baro_Alt = Simulink.Parameter(50, Unit="Hz")
f_GPS = Simulink.Parameter(10, Unit="Hz")
f_Pitot = Simulink.Parameter(50, Unit="Hz")
density_of_air = Simulink.Parameter(1.2, Unit="pascal")
g = Simulink.Parameter(9.8, Unit="m/sec^2")